# Grasshopper definition PTI_ramp tool.gh (Grasshopper 1.0.7)

O = ConstructPoint(XCoordinate=0, YCoordinate=0, ZCoordinate=0)
platform_height = Slider(0.92, range=0.8..1.15)
train_offset = Slider(1.51, range=0..2)
train_height = Slider(1.2, range=0..2)
rads = Slider(0.14, range=0.07..0.14)
Z = UnitZ(Factor=platform_height)
platform_offset = Addition(A=train_offset, B=Slider(0.33, range=0..0.6))
platform_width = Slider(2.5, range=2.5..5)
python = GhPythonScript(tx=train_offset, tz=train_height, px=platform_offset, pz=platform_height, da=rads)  # -> out, x, z
# ---------- python: Python ----------
__author__ = "302333"
__version__ = "2023.03.03"

#tx, tz correspond to train floor edge (x,z) coordinates#
#px, pz correspond to platform edge (x,z) coordinates#
#da is the deployment angle in rads#

import rhinoscriptsyntax as rs
import math
x = tx + (tz - pz) / math.tan(da)
z = pz + (x - px) * math.tan(da)
# ---------- end python ----------
Z_2 = UnitZ(Factor=train_height)
vec = VectorXYZ(XComponent=train_offset, YComponent=0, ZComponent=train_height)  # -> Vector, Length
vec_2 = VectorXYZ(XComponent=platform_offset, YComponent=0, ZComponent=Z)  # -> Vector, Length
platform_edge = Move(Geometry=O, Motion=vec_2.Vector)  # -> Geometry, Transform
train_floor_edge = Move(Geometry=O, Motion=vec.Vector)  # -> Geometry, Transform
move = Move(Geometry=O, Motion=Z_2)  # -> Geometry, Transform
pt = ConstructPoint(XCoordinate=python.x, YCoordinate=0, ZCoordinate=python.z)
X = UnitX(Factor=platform_width)
train_floor = Line(StartPoint=train_floor_edge.Geometry, EndPoint=move.Geometry)
platform_end = Move(Geometry=platform_edge.Geometry, Motion=X)  # -> Geometry, Transform
extr = Extrude(Base=train_floor, Direction=expr("-x", Z_2))
platform = Line(StartPoint=platform_edge.Geometry, EndPoint=platform_end.Geometry)
crv_cp = CurveClosestPoint(Point=pt, Curve=platform)  # -> Point, Parameter, Distance
extr_2 = Extrude(Base=platform, Direction=expr("-x", Z))
ramp = Line(StartPoint=train_floor_edge.Geometry, EndPoint=crv_cp.Point)
multiplication = Multiplication(A=crv_cp.Parameter, B=platform_width)
angle = Angle(VectorA=ramp, VectorB=platform)  # -> Angle, Reflex
len = Length(Curve=ramp)
deg = Degrees(Radians=angle.Angle)
concat = Concatenate(FragmentA=multiplication, FragmentB=" metres from platform edge point")
concat_2 = Concatenate(FragmentA=len, FragmentB=" metres")

# ---- group: Deployment position
panel = Panel(concat)

# ---- group: Deployment angle in degrees
panel_2 = Panel(deg)

# ---- group: Ramp length
panel_3 = Panel(concat_2)
